# Grasshopper definition SimplifiedWaterTower.gh (Grasshopper 0.9.76)
# Copyright: Co-de-iT

leaf_amount = Slider(6, range=1..7)
stem_radius = Slider(7.4, range=1..20)
leaf_angle = Slider(3.166, range=0..6.283)
tower_height = Slider(180, range=0..300)
randomise_angle = BooleanToggle(True)
tower_base = Point(Point(0, 0, 0))
randomised_angles = Boolean(randomise_angle)
tower_height_2 = Data(tower_height)
leaf_angle_2 = Data(leaf_angle)
leaf_amount_2 = Data(leaf_amount)
Z = UnitZ(Factor=tower_height_2)
avr = Average(Input=leaf_angle_2)
range = Range(Domain=Domain(0.1, 1), Steps=expr("x+1", leaf_amount_2))
move = Move(Geometry=tower_base, Motion=Z)  # -> Geometry, Transform
leaf_base_point = Point(Point(5.202841518, -16.5858726, 0))
random = Random(Range=Domain(0, 6.283), Number=leaf_amount_2, Seed=avr)
crv = Curve(<curve referenced from the Rhino model>)
ln = Line(StartPoint=tower_base, EndPoint=move.Geometry)
multiplication = Multiplication(A=random, B=randomised_angles)
cyl = Cylinder(Base=tower_base, Radius=stem_radius, Length=tower_height_2)
split = SplitList(List=range, Index=Slider(1, range=0..1))  # -> ListA, ListB
addition = Addition(A=leaf_angle_2, B=multiplication)
split_2 = SplitList(List=split.ListB, Index=leaf_amount_2)  # -> ListA, ListB
rotate = Rotate(Geometry=crv, Angle=addition, Plane=leaf_base_point)  # -> Geometry, Transform
eval = EvaluateCurve(Curve=ln, Parameter=split_2.ListA)  # -> Point, Tangent, Angle
vec2pt = Vector2Pt(PointA=leaf_base_point, PointB=eval.Point, Unitize=False)  # -> Vector, Length
move_2 = Move(Geometry=rotate.Geometry, Motion=vec2pt.Vector)  # -> Geometry, Transform
boundary = BoundarySurfaces(Edges=move_2.Geometry)
Z_2 = UnitZ(Factor=Slider(1, range=0..1))
extr = Extrude(Base=boundary, Direction=Z_2)
deextrusion_1_1 = DeconstructExtrusion11(brep=extr)  # -> doc_2, G, bh_3, bh_4
polyjson_1_1 = PolygonToGeoJSON11(P=deextrusion_1_1.G)  # -> doc_2, J_2

# ==== cluster PolygonToGeoJSON11: Writes a polygon to a GeoJSON file, where keys and values can be defined.
P = ClusterInput()
P_2 = Curve(P)
cp = ControlPoints(Curve=P_2)  # -> simplify(Points), Weights, Knots
V = ClusterInput()
K = ClusterInput()
V_2 = Data(simplify(V))
points_to_coordinates = PointsToCoordinates(P=cp.Points)
K_2 = Text(simplify(K))
clean = CleanTree(RemoveNulls=True, RemoveInvalid=True, RemoveEmpty=True, Tree=V_2)
viewer = ParamViewer(clean)
flip = FlipMatrix(Data=clean)
graft = GraftTree(Tree=K_2, IncludeEmptyLists=True, IncludeNullItems=True)  # -> simplify(Tree)
viewer_2 = ParamViewer(graft)
short = ShortestList(ListA=viewer_2, ListB=viewer, TrimMode=2)  # -> ListA, ListB
lng = ListLength(List=flatten(short.ListB))
series = Series(Start=0, Step=1, Count=lng)
item = ListItem(List=viewer_2, Index=series, Wrap=False)
flip_2 = FlipMatrix(Data=flip)
branch = TreeBranch(Tree=graft, Path=item, MaintainPaths=True)
clean_2 = CleanTree(RemoveNulls=True, RemoveInvalid=True, RemoveEmpty=True, Tree=branch)
flatten = FlattenTree(Tree=clean_2, Path="{0}")
rep = ReplaceText(Text="\"█\"", Find="█", Replace=flatten, RecursiveReplace=False)  # -> flatten(Result)
series_2 = Series(Start=0, Step=1, Count=lng)
mindex = MemberIndex(Set=rep, Member="\"height\"")  # -> Index, Count
rep_2 = ReplaceText(Text="{ \"type\": \"Polygon\",█}", Find="█", Replace=points_to_coordinates, RecursiveReplace=False)

# ---- group: Polygon
flatten_2 = FlattenTree(Tree=rep_2, Path="{0}")

# ----
mindex_2 = MemberIndex(Set=rep, Member="\"base_height\"")  # -> Index, Count
panel = Panel("Writes a polygon to a GeoJSON file, where keys and values can be defined. ")
panel_2 = Panel("""OUTPUTS:

GeoJSON (J) - Produces a GeoJSON Feature Collection.""")
panel_3 = Panel(""" 
INPUTS: 

Polyline Curve (P) - Polygon or list of polygons to convert to GeoJSON.

Key (K)- Properties used to describe geometry. To specify height, base height and colour, use the following keys: 

height
base_height
colour 

Value (V) - Values of properties. The list should be structured so that the first branch of data is associated with the first key. This allows unique values to be associated with multiple polygons. """)
panel_4 = Panel("For more documentation visit: github.com/madeleinejohanson/Humpback")
rep_3 = ReplaceText(Text="{\"type\":\"Feature\",\"geometry\":█", Find="█", Replace=flatten_2, RecursiveReplace=False)
merge = Merge(Data1="POLYGON TO GEOJSON", Data2=panel, Data3=panel_3, Data6=panel_2, Data7=panel_4)
doc = Text(merge)
doc_2 = ClusterOutput(doc)
panel_5 = Panel(doc)

# ---- group: Keeps lists consistent lengths, repeating the last value for the total amount of keys
null = NullItem(Item=flip)  # -> NullFlags, InvalidFlags, Description
dispatch = Dispatch(List=flip, DispatchPattern=null.NullFlags)  # -> ListA, ListB
nullrep = ReplaceNulls(Items=flip, Replacements="█")  # -> Items, Count
index = ItemIndex(List=dispatch.ListB, Item=dispatch.ListB)
item_2 = ListItem(List=flip, Index=index, Wrap=True)
mindex_3 = MemberIndex(Set=nullrep.Items, Member="█")  # -> Index, Count
flip_3 = FlipMatrix(Data=item_2)
clean_3 = CleanTree(RemoveNulls=True, RemoveInvalid=True, RemoveEmpty=False, Tree=flip_3)
item_3 = ListItem(List=clean_3, Index=0, Wrap=True)  # -> flatten(Item1), Item

# ----
merge_2 = Merge(Data1=flip_3, Data2=flip_2)
clean_4 = CleanTree(RemoveNulls=True, RemoveInvalid=True, RemoveEmpty=False, Tree=merge_2)
item_4 = ListItem(List=clean_4, Index=0, Wrap=True)  # -> flatten(Item1), Item

# ---- group: Keeps lists consistent lengths, repeating the last value for the total amount of keys (continued)
item_5 = ListItem(List=item_4.Item1, Index=mindex_3.Index, Wrap=True)
replace = ReplaceItems(List=nullrep.Items, Item=item_5, Indices=mindex_3.Index, Wrap=False)

# ----
flip_4 = FlipMatrix(Data=replace)
viewer_3 = ParamViewer(flip_4)
item_6 = ListItem(List=viewer_3, Index=series_2, Wrap=True)

# ---- group: Keeps lists consistent lengths, repeating the last value for the total amount of keys (continued)
branch_2 = TreeBranch(Tree=flip_4, Path=item_6, MaintainPaths=True)  # -> simplify(Branch)

# ----
flip_5 = FlipMatrix(Data=branch_2)

# ---- group: height
item_7 = ListItem(List=flip_5, Index=mindex.Index, Wrap=True)

# ---- group: base_height
item_8 = ListItem(List=flip_5, Index=mindex_2.Index, Wrap=True)

# ----
addition = Addition(A=item_7, B=item_8)
replace_2 = ReplaceItems(List=simplify(flip_5), Item=addition, Indices=mindex.Index, Wrap=False)  # -> simplify(List)
clean_5 = CleanTree(RemoveNulls=True, RemoveInvalid=True, RemoveEmpty=True, Tree=replace_2)
key_value = KeyValue(K=clean_2, V=clean_5)
rep_4 = ReplaceText(Text=",\"properties\":█}", Find="█", Replace=key_value, RecursiveReplace=False)

# ---- group: Feature
concat = Concatenate(FragmentA=rep_3, FragmentB=rep_4)  # -> flatten(Result)

# ----
join = TextJoin(Text=concat, Join=",")
panel_6 = Panel(key_value)
rep_5 = ReplaceText(Text="{\"type\":\"FeatureCollection\",\"features\":[█]}", Find="█", Replace=join, RecursiveReplace=False)
J = Text(rep_5)
J_2 = ClusterOutput(J)

# ==== cluster DeconstructExtrusion11: Deconstructs simple extrusions into polylines, heights, and base heights for later use in ‘Polygon to GeoJSON component’.
brep = ClusterInput()
brep_2 = Brep(simplify(graft(brep)))
cap = CapHoles(Brep=brep_2)
mesh = MeshBrep(
    Brep=cap,
    Settings={GridMaxCount=0, GridMinCount=16, JaggedSeams=False, MaxEdgeLength=0, MinEdgeLength=0.0001, MinTolerance=0, Refine=True, RefineAngle=0, RelativeTolerance=0.65, SimplePlanes=True, Tolerance=0})
mshadow = MeshShadow(Mesh=mesh, Light=Vector(0, 0, -1), Plane=PlaneXY(0, 0, 0))
demesh = DeconstructMesh(Mesh=mesh)  # -> Vertices, Faces, Colours, Normals
pdecon = Deconstruct(Point=demesh.Vertices)  # -> XComponent, YComponent, ZComponent
panel = Panel("Deconstructs simple extrusions into polylines, heights, and base heights for later use in ‘Polygon to GeoJSON component’.")
panel_2 = Panel(""" 
INPUTS: 

Brep (B) - Extruded or capped Breps. Must be extruded in the z axis. """)
panel_3 = Panel("""OUTPUTS:

Polyline (Crv)- Projected base polyline of Brep.

Height (H) - Height of Brep.The distance of extrusion. 

Base Height (BH) - The height of the base of the brep from the ground XY Plane.""")
sort = SortList(Keys=pdecon.ZComponent)  # -> Keys, ValuesA
item = ListItem(List=sort.Keys, Index=0, Wrap=True)  # -> Item1, Item
panel_4 = Panel("For more documentation visit: github.com/madeleinejohanson/Humpback")
subtraction = Subtraction(A=item.Item1, B=item.Item)
bh = Data(simplify(flatten(subtraction)))
bh_2 = Data(simplify(flatten(item.Item)))
Z = UnitZ(Factor=bh_2)
merge = Merge(Data1="DECONSTRUCT EXTRUSION", Data2=panel, Data3=panel_2, Data4=panel_3, Data5=panel_4)
move = Move(Geometry=flatten(mshadow), Motion=Z)  # -> Geometry, Transform
doc = Text(merge)
doc_2 = ClusterOutput(doc)
panel_5 = Panel(doc)

# ---- group: Cluster Output
bh_3 = ClusterOutput(bh)

# ----
bh_4 = ClusterOutput(bh_2)
G = ClusterOutput(move.Geometry)

# ==== cluster PointsToCoordinates
P = ClusterInput()
number_slider = Slider(100042, range=0..1000000)
pt2num = PointsToNumbers(Points=graft(P), Mask=4)
number_slider_2 = Slider(1000404, range=0..10000000)
division = Division(A=pt2num, B=Slider(100000, range=0..100000))
expression = Expression(x=division, Expression="format(\"{0}\",x)")
int = Integer(99960)
item = ListItem(List=expression, Index=0, Wrap=True)  # -> Item, Item1, Item2
panel = Panel(pt2num)
num = Number(item.Item2)  # disabled
merge = Merge(Data1=item.Item, Data2=item.Item1, Data3=num)
panel_2 = Panel(division)
wrapper = Wrapper(wrap="[", content=merge, join=",")  # -> simplify(wrapped)
utrim = UberTrim(data=wrapper, bool=Toggle(True))
wrapper_2 = Wrapper(wrap="[", content=utrim, join=",")
rep = ReplaceText(Text="\"coordinates\": [█]", Find="█", Replace=wrapper_2, RecursiveReplace=False)  # -> simplify(Result)
R = ClusterOutput(rep)

# ==== cluster KeyValue
K = ClusterInput()
V = ClusterInput()
K_2 = Text(simplify(K))
V_2 = Data(simplify(V))

# ---- group: HUMPBACK 1.1 Treats numbers as numbers instead of strings
int = Integer(V_2)
null = NullItem(Item=int)  # -> NullFlags, InvalidFlags, Description
panel = Panel("""█
"█"
""")
item = ListItem(List=panel, Index=null.NullFlags, Wrap=True)
rep = ReplaceText(Text=item, Find="█", Replace=V_2, RecursiveReplace=False)

# ----
panel_2 = Panel(K_2)
rep_2 = ReplaceText(Text="\"█\"", Find="█", Replace=K_2, RecursiveReplace=False)  # -> simplify(Result)
panel_3 = Panel("\"█\"")  # disabled
panel_4 = Panel("█")  # disabled
rep_3 = ReplaceText(Text=panel_3, Find=panel_4, Replace=V_2, RecursiveReplace=False)  # disabled
flip = FlipMatrix(Data=rep)  # -> simplify(Data)
lng = ListLength(List=flatten(rep_2))
viewer = ParamViewer(flip)
series = Series(Start=0, Step=1, Count=lng)
item_2 = ListItem(List=viewer, Index=series, Wrap=True)
branch = TreeBranch(Tree=simplify(flip), Path=simplify(item_2), MaintainPaths=True)
long = LongestList(ListA=rep_2, ListB=branch, PaddingMode=2)  # -> ListA, ListB
merge = Merge(Data1=graft(long.ListA), Data2=graft(long.ListB))
join = TextJoin(Text=merge, Join=":")
trim = TrimTree(Tree=join, Depth=1)
flip_2 = FlipMatrix(Data=trim)
join_2 = TextJoin(Text=flip_2, Join=",")
rep_4 = ReplaceText(Text="{█}", Find="█", Replace=join_2, RecursiveReplace=False)  # -> flatten(Result)
J = Text(rep_4)
J_2 = ClusterOutput(J)

# ==== cluster UberTrim: Better version of Trim
data = ClusterInput()
bool = ClusterInput()
data_2 = Data(data)
trim = TrimTree(Tree=data_2, Depth=1)
null = NullItem(Item=trim)  # -> NullFlags, InvalidFlags, Description
dispatch = Dispatch(List=data_2, DispatchPattern=null.NullFlags)  # -> ListA, ListB
bool_2 = Boolean(bool)
trim_2 = TrimTree(Tree=dispatch.ListB, Depth=1)
bool_3 = Boolean(invert(null.NullFlags))
flatten = FlattenTree(Tree=dispatch.ListA, Path="{0}")
merge = Merge(Data1=flatten, Data2=trim_2)
panel = Panel(null.NullFlags)
trim_3 = TrimTree(Tree=data_2, Depth=bool_3)
bool_4 = Boolean(invert(bool_2))
data_3 = Data(trim_3)
dispatch_2 = Dispatch(List=merge, DispatchPattern=bool_4)  # -> ListA, ListB
dispatch_3 = Dispatch(List=data_3, DispatchPattern=bool_2)  # -> ListA, ListB
clean = CleanTree(RemoveNulls=True, RemoveInvalid=True, RemoveEmpty=True, Tree=dispatch_3.ListB)
clean_2 = CleanTree(RemoveNulls=True, RemoveInvalid=True, RemoveEmpty=True, Tree=dispatch_2.ListB)
merge_2 = Merge(Data1=clean, Data2=clean_2)
R = ClusterOutput(merge_2)
panel_2 = Panel(merge_2)

# ==== cluster Wrapper: Wraps data with a wrapping character
join = ClusterInput()  # Join character
content = ClusterInput()  # Content to be wrapped
wrap = ClusterInput()  # Wrap character or XML tag
txt = Text(join)
null = NullItem(Item=txt)  # -> NullFlags, InvalidFlags, Description
data = Data(content)
tmatch = MatchText(Text=wrap, RegEx="<*.>", Case=True)
bool = Boolean(null.NullFlags)
dispatch = Dispatch(List=data, DispatchPattern=bool)  # -> ListA, ListB
item = ListItem(List=wrap, Index=0, Wrap=True)
split = TextSplit(Text=item, Separators=" ")
join_2 = TextJoin(Text=dispatch.ListB, Join=txt)
panel = Panel("""{
[
(
"
'""")
panel_2 = Panel("""{█}
[█]
(█)
"█"
'█'""")
item_2 = ListItem(List=split, Index=0, Wrap=True)
weave = Weave(Pattern=bool, Stream0=join_2, Stream1=dispatch.ListA, NullGaps=False)
data_2 = Data(wrap)
replace = ReplaceMembers(Set=data_2, Find=panel, Replace=panel_2)
rep = ReplaceText(Text=item_2, Find="<", Replace="</", RecursiveReplace=False)
expression = Expression(x=item, y=rep, Expression="Format(\"{0}█{1}>\", x, y)")
rep_2 = ReplaceText(Text=expression, Find=">>", Replace=">", RecursiveReplace=False)
weave_2 = Weave(Pattern=tmatch, Stream0=replace, Stream1=rep_2, NullGaps=False)
rep_3 = ReplaceText(Text=weave_2, Find="█", Replace=weave, RecursiveReplace=False)
data_3 = Data(rep_3)
wrapped = ClusterOutput(data_3)  # Wrapped Output
