# Grasshopper definition SimplifiedWaterTowerPositioned_2.gh (Grasshopper 0.9.76)
# Copyright: Co-de-iT

tower_base = Point(Point(12.66648147, -734.470674, 0))
tower_base_2 = Point(Point(104.1067809, -710.4851448, 0))
tower_base_3 = Point(Point(289.4749567, -661.8971278, 0))
tower_base_4 = Point(Point(175.4110514, -547.152541, 0))
tower_base_5 = Point(Point(184.0426746, -632.5844025, 0))
tower_base_6 = Point(Point(-65.4503501, -813.2889303, 0))
tower_base_7 = Point(Point(-242.8915409, -848.3763943, 0))
tower_base_8 = Point(Point(-138.0250899, -888.881805, 0))
tower_base_9 = Point(Point(-57.81300254, -969.1895669, 0))
tower_base_10 = Point(Point(155.681736, -446.7975141, 0))
tower_base_11 = Point(Point(378.2077672, -699.2470495, 0))
tower_base_12 = Point(Point(52.86316143, -433.6796714, 0))
tower_base_13 = Point(Point(-11.08602386, -1040.138356, 0))
tower_base_14 = Point(Point(770.0253095, -899.1999977, 0))
tower_base_15 = Point(Point(480.3079463, -733.2804425, 0))
tower_base_16 = Point(Point(575.8632421, -714.9547694, 0))
tower_base_17 = Point(Point(764.2427589, -802.9794093, 0))
tower_base_18 = Point(Point(125.3698281, -1058.161068, 0))
tower_base_19 = Point(Point(683.4417308, -720.5623607, 0))
tower_base_20 = Point(Point(770.7068411, -680.1618467, 0))
tower_base_21 = Point(Point(449.5442381, -1134.650964, 0))
tower_base_22 = Point(Point(346.5215409, -1166.722435, 0))
tower_base_23 = Point(Point(231.9745448, -1114.365459, 0))
tower_base_24 = Point(Point(549.9407779, -1169.621137, 0))
tower_base_25 = Point(Point(815.6364239, -979.712591, 0))
tower_base_26 = Point(Point(815.6364239, -1076.820009, 0))
tower_base_27 = Point(Point(882.9571226, -1262.421302, 0))
tower_base_28 = Point(Point(673.5841656, -1170.868351, 0))
tower_base_29 = Point(Point(793.4072805, -1185.562548, 0))
random_seed = Slider(7.7, range=0..10)
random_seed_2 = Slider(7.24, range=0..10)
random_seed_3 = Slider(5.94, range=0..10)
random_seed_4 = Slider(1.96, range=0..10)
random_seed_5 = Slider(6.56, range=0..10)
random_seed_6 = Slider(3.57, range=0..10)
random_seed_7 = Slider(3.33, range=0..10)
random_seed_8 = Slider(4.77, range=0..10)
random_seed_9 = Slider(8.66, range=0..10)
random_seed_10 = Slider(6.4, range=0..10)
random_seed_11 = Slider(7.49, range=0..10)
random_seed_12 = Slider(8.54, range=0..10)
random_seed_13 = Slider(8.54, range=0..10)
random_seed_14 = Slider(2.12, range=0..10)
random_seed_15 = Slider(7.78, range=0..10)
random_seed_16 = Slider(6.42, range=0..10)
random_seed_17 = Slider(8.12, range=0..10)
random_seed_18 = Slider(8.54, range=0..10)
random_seed_19 = Slider(1.82, range=0..10)
random_seed_20 = Slider(1.86, range=0..10)
random_seed_21 = Slider(8.54, range=0..10)
random_seed_22 = Slider(8.54, range=0..10)
random_seed_23 = Slider(8.54, range=0..10)
random_seed_24 = Slider(8.54, range=0..10)
random_seed_25 = Slider(8.54, range=0..10)
random_seed_26 = Slider(8.54, range=0..10)
random_seed_27 = Slider(8.54, range=0..10)
random_seed_28 = Slider(8.54, range=0..10)
random_seed_29 = Slider(8.54, range=0..10)
towerpolygen = TowerPolyGen(tower_base=tower_base, random_seed=random_seed, colour="red", layer="layer1")  # -> tower, J
towerpolygen_2 = TowerPolyGen(tower_base=tower_base_2, random_seed=random_seed_2, colour="red", layer="layer1")  # -> tower, J
towerpolygen_3 = TowerPolyGen(tower_base=tower_base_6, random_seed=random_seed_5, colour="red", layer="layer1")  # -> tower, J
towerpolygen_4 = TowerPolyGen(tower_base=tower_base_3, random_seed=random_seed_4, colour="red", layer="layer1")  # -> tower, J
# top left:
# -33.818231, 151.109357
# 
# bottom right:
# -33.883882, 151.254660
towerpolygen_5 = TowerPolyGen(tower_base=tower_base_4, random_seed=random_seed_3, colour="red", layer="layer1")  # -> tower, J
towerpolygen_6 = TowerPolyGen(tower_base=tower_base_5, random_seed=random_seed_6, colour="red", layer="layer1")  # -> tower, J
towerpolygen_7 = TowerPolyGen(tower_base=tower_base_7, random_seed=random_seed_7, colour="red", layer="layer1")  # -> tower, J
towerpolygen_8 = TowerPolyGen(tower_base=tower_base_8, random_seed=random_seed_8, colour="red", layer="layer1")  # -> tower, J
towerpolygen_9 = TowerPolyGen(tower_base=tower_base_9, random_seed=random_seed_9, colour="red", layer="layer1")  # -> tower, J
towerpolygen_10 = TowerPolyGen(tower_base=tower_base_10, random_seed=random_seed_10, colour="red", layer="layer1")  # -> tower, J
towerpolygen_11 = TowerPolyGen(tower_base=tower_base_11, random_seed=random_seed_11, colour="red", layer="layer1")  # -> tower, J
towerpolygen_12 = TowerPolyGen(tower_base=tower_base_12, random_seed=random_seed_12, colour="red", layer="layer1")  # -> tower, J
towerpolygen_13 = TowerPolyGen(tower_base=tower_base_13, random_seed=random_seed_13, colour="red", layer="layer1")  # -> tower, J
towerpolygen_14 = TowerPolyGen(tower_base=tower_base_18, random_seed=random_seed_18, colour="red", layer="layer1")  # -> tower, J
towerpolygen_15 = TowerPolyGen(tower_base=tower_base_14, random_seed=random_seed_15, colour="red", layer="layer1")  # -> tower, J
towerpolygen_16 = TowerPolyGen(tower_base=tower_base_15, random_seed=random_seed_14, colour="red", layer="layer1")  # -> tower, J
towerpolygen_17 = TowerPolyGen(tower_base=tower_base_16, random_seed=random_seed_16, colour="red", layer="layer1")  # -> tower, J
towerpolygen_18 = TowerPolyGen(tower_base=tower_base_17, random_seed=random_seed_17, colour="red", layer="layer1")  # -> tower, J
towerpolygen_19 = TowerPolyGen(tower_base=tower_base_21, random_seed=random_seed_21, colour="red", layer="layer1")  # -> tower, J
towerpolygen_20 = TowerPolyGen(tower_base=tower_base_19, random_seed=random_seed_19, colour="red", layer="layer1")  # -> tower, J
towerpolygen_21 = TowerPolyGen(tower_base=tower_base_20, random_seed=random_seed_20, colour="red", layer="layer1")  # -> tower, J
towerpolygen_22 = TowerPolyGen(tower_base=tower_base_22, random_seed=random_seed_22, colour="red", layer="layer1")  # -> tower, J
towerpolygen_23 = TowerPolyGen(tower_base=tower_base_23, random_seed=random_seed_23, colour="red", layer="layer1")  # -> tower, J
towerpolygen_24 = TowerPolyGen(tower_base=tower_base_24, random_seed=random_seed_24, colour="red", layer="layer1")  # -> tower, J
towerpolygen_25 = TowerPolyGen(tower_base=tower_base_25, random_seed=random_seed_25, colour="red", layer="layer1")  # -> tower, J
towerpolygen_26 = TowerPolyGen(tower_base=tower_base_27, random_seed=random_seed_27, colour="red", layer="layer1")  # -> tower, J
towerpolygen_27 = TowerPolyGen(tower_base=tower_base_26, random_seed=random_seed_26, colour="red", layer="layer1")  # -> tower, J
towerpolygen_28 = TowerPolyGen(tower_base=tower_base_29, random_seed=random_seed_29, colour="red", layer="layer1")  # -> tower, J
towerpolygen_29 = TowerPolyGen(tower_base=tower_base_28, random_seed=random_seed_28, colour="red", layer="layer1")  # -> tower, J
merge = Merge(
    Data1=towerpolygen_5.J,
    Data2=towerpolygen_6.J,
    Data3=towerpolygen_4.J,
    Data4=towerpolygen_2.J,
    Data5=towerpolygen.J,
    Data6=towerpolygen_3.J,
    Data7=towerpolygen_7.J,
    Data8=towerpolygen_8.J,
    Data9=towerpolygen_9.J,
    Data10=towerpolygen_10.J,
    Data11=towerpolygen_11.J)
mergegj = MergeGeoJSON(data=merge)  # -> doc_2, R
file_write = FileWrite(content=mergegj.R, file_path="C:/", T="watertowers.json", activate=Toggle(False))

# ==== cluster FileWrite: Exports text to file
content = ClusterInput()
file_path = ClusterInput()
activate = ClusterInput()
T = ClusterInput()
content_2 = Data(content)
file_path_2 = Text(file_path)
join = TextJoin(Text=[file_path_2, T], Join="\")
vb = VBScript(path=simplify(join), lines=simplify(content_2), activate=activate)  # -> out, A
# ---------- vb: VB ----------
    If (activate = True)
      
      system.IO.File.WriteAllText(path, lines)
      A = "File written"
    Else
      A = "Not activated"
    End If
# ---------- end vb ----------

# ==== cluster TowerPolyGen
tower_base = ClusterInput()
random_seed = ClusterInput()
towerpoly = TowerPoly(tower_base=tower_base, random_seed=random_seed)  # -> tower_2, curve_2, height_2, base_height_2
layer = ClusterInput()
colour = ClusterInput()
colour_2 = Data(colour)
layer_2 = Data(layer)
base_height = Data(towerpoly.base_height_2)
curve = Data(towerpoly.curve_2)
height = Data(towerpoly.height_2)
panel = Panel(height)
panel_2 = Panel(base_height)
panel_3 = Panel(colour_2)
panel_4 = Panel(layer_2)
panel_5 = Panel("""height
base_height
colour
layer""")
entwine = Entwine(Branch00=panel, Branch01=panel_2, Branch02=panel_3, Branch03=panel_4, FlattenInputs=True)
tower = ClusterOutput(towerpoly.tower_2)
polyjson_1_1 = PolygonToGeoJSON11(K=panel_5, V=entwine)  # -> doc_2, J_2
J = ClusterOutput(polyjson_1_1.J_2)

# ==== cluster MergeGeoJSON: Merges multiple GeoJSON FeatureCollection files as one FeatureCollection.
panel = Panel("Merges multiple GeoJSON FeatureCollection files as one FeatureCollection. ")
data = ClusterInput()
panel_2 = Panel(""" 
INPUTS: 

GeoJSON Datasets (D) - Accept multiple FeatureCollections. Created for merging the outputs of "Polygon to GeoJSON" components. """)
panel_3 = Panel("""OUTPUTS:

GeoJSON(J) - Merged GeoJSON file as one Feature Colleciton """)
data_2 = Data(data)
panel_4 = Panel("For more documentation visit: github.com/madeleinejohanson/Humpback")
join = TextJoin(Text=data_2)
rep = ReplaceText(Text=join, Find="]}{\"type\":\"FeatureCollection\",\"features\":[", Replace=",", RecursiveReplace=False)
R = ClusterOutput(rep)
merge = Merge(Data1="GEOJSON MERGE", Data2=panel, Data3=panel_2, Data4=panel_3, Data5=panel_4)
doc = Text(merge)
panel_5 = Panel(doc)
doc_2 = ClusterOutput(doc)

# ==== cluster PolygonToGeoJSON11: Writes a polygon to a GeoJSON file, where keys and values can be defined.
P = ClusterInput()
P_2 = Curve(P)
cp = ControlPoints(Curve=P_2)  # -> simplify(Points), Weights, Knots
V = ClusterInput()
K = ClusterInput()
V_2 = Data(simplify(V))
points_to_coordinates = PointsToCoordinates(P=cp.Points)
K_2 = Text(simplify(K))
clean = CleanTree(RemoveNulls=True, RemoveInvalid=True, RemoveEmpty=True, Tree=V_2)
viewer = ParamViewer(clean)
flip = FlipMatrix(Data=clean)
graft = GraftTree(Tree=K_2, IncludeEmptyLists=True, IncludeNullItems=True)  # -> simplify(Tree)
viewer_2 = ParamViewer(graft)
short = ShortestList(ListA=viewer_2, ListB=viewer, TrimMode=2)  # -> ListA, ListB
lng = ListLength(List=flatten(short.ListB))
series = Series(Start=0, Step=1, Count=lng)
item = ListItem(List=viewer_2, Index=series, Wrap=False)
flip_2 = FlipMatrix(Data=flip)
branch = TreeBranch(Tree=graft, Path=item, MaintainPaths=True)
clean_2 = CleanTree(RemoveNulls=True, RemoveInvalid=True, RemoveEmpty=True, Tree=branch)
flatten = FlattenTree(Tree=clean_2, Path="{0}")
rep = ReplaceText(Text="\"█\"", Find="█", Replace=flatten, RecursiveReplace=False)  # -> flatten(Result)
series_2 = Series(Start=0, Step=1, Count=lng)
mindex = MemberIndex(Set=rep, Member="\"height\"")  # -> Index, Count
rep_2 = ReplaceText(Text="{ \"type\": \"Polygon\",█}", Find="█", Replace=points_to_coordinates, RecursiveReplace=False)

# ---- group: Polygon
flatten_2 = FlattenTree(Tree=rep_2, Path="{0}")

# ----
mindex_2 = MemberIndex(Set=rep, Member="\"base_height\"")  # -> Index, Count
panel = Panel("Writes a polygon to a GeoJSON file, where keys and values can be defined. ")
panel_2 = Panel("""OUTPUTS:

GeoJSON (J) - Produces a GeoJSON Feature Collection.""")
panel_3 = Panel(""" 
INPUTS: 

Polyline Curve (P) - Polygon or list of polygons to convert to GeoJSON.

Key (K)- Properties used to describe geometry. To specify height, base height and colour, use the following keys: 

height
base_height
colour 

Value (V) - Values of properties. The list should be structured so that the first branch of data is associated with the first key. This allows unique values to be associated with multiple polygons. """)
panel_4 = Panel("For more documentation visit: github.com/madeleinejohanson/Humpback")
rep_3 = ReplaceText(Text="{\"type\":\"Feature\",\"geometry\":█", Find="█", Replace=flatten_2, RecursiveReplace=False)
merge = Merge(Data1="POLYGON TO GEOJSON", Data2=panel, Data3=panel_3, Data6=panel_2, Data7=panel_4)
doc = Text(merge)
doc_2 = ClusterOutput(doc)
panel_5 = Panel(doc)

# ---- group: Keeps lists consistent lengths, repeating the last value for the total amount of keys
null = NullItem(Item=flip)  # -> NullFlags, InvalidFlags, Description
dispatch = Dispatch(List=flip, DispatchPattern=null.NullFlags)  # -> ListA, ListB
nullrep = ReplaceNulls(Items=flip, Replacements="█")  # -> Items, Count
index = ItemIndex(List=dispatch.ListB, Item=dispatch.ListB)
item_2 = ListItem(List=flip, Index=index, Wrap=True)
mindex_3 = MemberIndex(Set=nullrep.Items, Member="█")  # -> Index, Count
flip_3 = FlipMatrix(Data=item_2)
clean_3 = CleanTree(RemoveNulls=True, RemoveInvalid=True, RemoveEmpty=False, Tree=flip_3)
item_3 = ListItem(List=clean_3, Index=0, Wrap=True)  # -> flatten(Item1), Item

# ----
merge_2 = Merge(Data1=flip_3, Data2=flip_2)
clean_4 = CleanTree(RemoveNulls=True, RemoveInvalid=True, RemoveEmpty=False, Tree=merge_2)
item_4 = ListItem(List=clean_4, Index=0, Wrap=True)  # -> flatten(Item1), Item

# ---- group: Keeps lists consistent lengths, repeating the last value for the total amount of keys (continued)
item_5 = ListItem(List=item_4.Item1, Index=mindex_3.Index, Wrap=True)
replace = ReplaceItems(List=nullrep.Items, Item=item_5, Indices=mindex_3.Index, Wrap=False)

# ----
flip_4 = FlipMatrix(Data=replace)
viewer_3 = ParamViewer(flip_4)
item_6 = ListItem(List=viewer_3, Index=series_2, Wrap=True)

# ---- group: Keeps lists consistent lengths, repeating the last value for the total amount of keys (continued)
branch_2 = TreeBranch(Tree=flip_4, Path=item_6, MaintainPaths=True)  # -> simplify(Branch)

# ----
flip_5 = FlipMatrix(Data=branch_2)

# ---- group: height
item_7 = ListItem(List=flip_5, Index=mindex.Index, Wrap=True)

# ---- group: base_height
item_8 = ListItem(List=flip_5, Index=mindex_2.Index, Wrap=True)

# ----
addition = Addition(A=item_7, B=item_8)
replace_2 = ReplaceItems(List=simplify(flip_5), Item=addition, Indices=mindex.Index, Wrap=False)  # -> simplify(List)
clean_5 = CleanTree(RemoveNulls=True, RemoveInvalid=True, RemoveEmpty=True, Tree=replace_2)
key_value = KeyValue(K=clean_2, V=clean_5)
rep_4 = ReplaceText(Text=",\"properties\":█}", Find="█", Replace=key_value, RecursiveReplace=False)

# ---- group: Feature
concat = Concatenate(FragmentA=rep_3, FragmentB=rep_4)  # -> flatten(Result)

# ----
join = TextJoin(Text=concat, Join=",")
panel_6 = Panel(key_value)
rep_5 = ReplaceText(Text="{\"type\":\"FeatureCollection\",\"features\":[█]}", Find="█", Replace=join, RecursiveReplace=False)
J = Text(rep_5)
J_2 = ClusterOutput(J)

# ==== cluster TowerPoly
tower_base = ClusterInput()
level_thickness = Slider(2, range=0..5)
tower_height = Slider(180, range=0..300)
leaf_amount = Slider(6, range=1..7)
stem_radius = Slider(5.6, range=1..20)
randomise_angle = BooleanToggle(True)
random_seed = ClusterInput()
leaf_angle = Slider(2.867, range=0..6.283)
tower_base_2 = Point(tower_base)
random_seed_2 = Data(random_seed)
bottom_right = Point(Point(5143.874652, -4040.62199, 0))
top_left = Point(Point(-7096.812867, 2577.217604, 0))
panel = Panel("bottom right")
panel_2 = Panel("top left")
simple_water_tower = SimpleWaterTower(
    tower_base=tower_base_2,
    level_thickness=level_thickness,
    tower_height=tower_height,
    leaf_angle=leaf_angle,
    stem_radius=stem_radius,
    randomised_angles=randomise_angle,
    leaf_amount=leaf_amount,
    random_seed=random_seed_2)
pdecon = Deconstruct(Point=top_left)  # -> XComponent, YComponent, ZComponent
pdecon_2 = Deconstruct(Point=bottom_right)  # -> XComponent, YComponent, ZComponent
pdecon_3 = Deconstruct(Point=tower_base_2)  # -> XComponent, YComponent, ZComponent
dom = ConstructDomain(DomainStart=Slider(-33.818231, range=-33.883882..-33.818231), DomainEnd=Slider(-33.883882, range=-33.883882..-33.818231))
dom_2 = ConstructDomain(DomainStart=Slider(151.109357, range=151.109357..151.25466), DomainEnd=Slider(151.109357, range=151.109357..151.25466))
tower = Brep(simple_water_tower)
dom_3 = ConstructDomain(DomainStart=pdecon.XComponent, DomainEnd=pdecon_2.XComponent)
dom_4 = ConstructDomain(DomainStart=pdecon.YComponent, DomainEnd=pdecon_2.YComponent)
deextrusion_1_1 = DeconstructExtrusion11(brep=tower)  # -> doc_2, G, bh_3, bh_4
remap = RemapNumbers(Value=pdecon_3.YComponent, Source=dom_4, Target=dom_2)  # -> Mapped, Clipped
remap_2 = RemapNumbers(Value=pdecon_3.XComponent, Source=dom_3, Target=dom)  # -> Mapped, Clipped
tower_2 = ClusterOutput(tower)
orientne = OrientNE(G=deextrusion_1_1.G, P=tower_base_2, N=remap_2.Mapped, E=remap.Mapped)  # -> doc_2, G_3, pt_2
base_height = Data(deextrusion_1_1.bh_4)
height = Data(deextrusion_1_1.bh_3)
curve = Data(orientne.G_3)
height_2 = ClusterOutput(height)
curve_2 = ClusterOutput(curve)
base_height_2 = ClusterOutput(base_height)

# ==== cluster PointsToCoordinates
P = ClusterInput()
number_slider = Slider(100042, range=0..1000000)
pt2num = PointsToNumbers(Points=graft(P), Mask=4)
number_slider_2 = Slider(1000404, range=0..10000000)
division = Division(A=pt2num, B=Slider(100000, range=0..100000))
expression = Expression(x=division, Expression="format(\"{0}\",x)")
int = Integer(99960)
item = ListItem(List=expression, Index=0, Wrap=True)  # -> Item, Item1, Item2
panel = Panel(pt2num)
num = Number(item.Item2)  # disabled
merge = Merge(Data1=item.Item, Data2=item.Item1, Data3=num)
panel_2 = Panel(division)
wrapper = Wrapper(wrap="[", content=merge, join=",")  # -> simplify(wrapped)
utrim = UberTrim(data=wrapper, bool=Toggle(True))
wrapper_2 = Wrapper(wrap="[", content=utrim, join=",")
rep = ReplaceText(Text="\"coordinates\": [█]", Find="█", Replace=wrapper_2, RecursiveReplace=False)  # -> simplify(Result)
R = ClusterOutput(rep)

# ==== cluster KeyValue
K = ClusterInput()
V = ClusterInput()
K_2 = Text(simplify(K))
V_2 = Data(simplify(V))

# ---- group: HUMPBACK 1.1 Treats numbers as numbers instead of strings
int = Integer(V_2)
null = NullItem(Item=int)  # -> NullFlags, InvalidFlags, Description
panel = Panel("""█
"█"
""")
item = ListItem(List=panel, Index=null.NullFlags, Wrap=True)
rep = ReplaceText(Text=item, Find="█", Replace=V_2, RecursiveReplace=False)

# ----
panel_2 = Panel(K_2)
rep_2 = ReplaceText(Text="\"█\"", Find="█", Replace=K_2, RecursiveReplace=False)  # -> simplify(Result)
panel_3 = Panel("\"█\"")  # disabled
panel_4 = Panel("█")  # disabled
rep_3 = ReplaceText(Text=panel_3, Find=panel_4, Replace=V_2, RecursiveReplace=False)  # disabled
flip = FlipMatrix(Data=rep)  # -> simplify(Data)
lng = ListLength(List=flatten(rep_2))
viewer = ParamViewer(flip)
series = Series(Start=0, Step=1, Count=lng)
item_2 = ListItem(List=viewer, Index=series, Wrap=True)
branch = TreeBranch(Tree=simplify(flip), Path=simplify(item_2), MaintainPaths=True)
long = LongestList(ListA=rep_2, ListB=branch, PaddingMode=2)  # -> ListA, ListB
merge = Merge(Data1=graft(long.ListA), Data2=graft(long.ListB))
join = TextJoin(Text=merge, Join=":")
trim = TrimTree(Tree=join, Depth=1)
flip_2 = FlipMatrix(Data=trim)
join_2 = TextJoin(Text=flip_2, Join=",")
rep_4 = ReplaceText(Text="{█}", Find="█", Replace=join_2, RecursiveReplace=False)  # -> flatten(Result)
J = Text(rep_4)
J_2 = ClusterOutput(J)

# ==== cluster SimpleWaterTower
level_thickness = ClusterInput()
tower_base = ClusterInput()
randomised_angles = ClusterInput()
stem_radius = ClusterInput()
tower_height = ClusterInput()
random_seed = ClusterInput()
leaf_angle = ClusterInput()
leaf_amount = ClusterInput()
level_thickness_2 = Data(level_thickness)
tower_base_2 = Point(tower_base)
randomised_angles_2 = Boolean(randomised_angles)
stem_radius_2 = Data(stem_radius)
tower_height_2 = Data(tower_height)
leaf_angle_2 = Data(leaf_angle)
random_seed_2 = Data(random_seed)
leaf_amount_2 = Data(leaf_amount)
Z = UnitZ(Factor=tower_height_2)
range = Range(Domain=Domain(0.1, 1), Steps=expr("x+1", leaf_amount_2))
move = Move(Geometry=tower_base_2, Motion=Z)  # -> Geometry, Transform
leaf_base_point = Point(Point(3.896008657, -18.35570401, 0))
random = Random(Range=Domain(0, 6.283), Number=leaf_amount_2, Seed=random_seed_2)
crv = Curve(<curve referenced from the Rhino model>)
ln = Line(StartPoint=tower_base_2, EndPoint=move.Geometry)
multiplication = Multiplication(A=random, B=randomised_angles_2)
cyl = Cylinder(Base=tower_base_2, Radius=stem_radius_2, Length=tower_height_2)
split = SplitList(List=range, Index=Slider(1, range=0..1))  # -> ListA, ListB
addition = Addition(A=leaf_angle_2, B=multiplication)
split_2 = SplitList(List=split.ListB, Index=leaf_amount_2)  # -> ListA, ListB
rotate = Rotate(Geometry=crv, Angle=addition, Plane=leaf_base_point)  # -> Geometry, Transform
cap = CapHoles(Brep=cyl)
eval = EvaluateCurve(Curve=ln, Parameter=split_2.ListA)  # -> Point, Tangent, Angle
vec2pt = Vector2Pt(PointA=leaf_base_point, PointB=eval.Point, Unitize=False)  # -> Vector, Length
move_2 = Move(Geometry=rotate.Geometry, Motion=vec2pt.Vector)  # -> Geometry, Transform
Z_2 = UnitZ(Factor=level_thickness_2)
boundary = BoundarySurfaces(Edges=move_2.Geometry)
extr = Extrude(Base=boundary, Direction=Z_2)
merge = Merge(Data1=extr, Data2=cap)
tower = Brep(merge)
tower_2 = ClusterOutput(tower)

# ==== cluster DeconstructExtrusion11: Deconstructs simple extrusions into polylines, heights, and base heights for later use in ‘Polygon to GeoJSON component’.
brep = ClusterInput()
brep_2 = Brep(simplify(graft(brep)))
cap = CapHoles(Brep=brep_2)
mesh = MeshBrep(
    Brep=cap,
    Settings={GridMaxCount=0, GridMinCount=16, JaggedSeams=False, MaxEdgeLength=0, MinEdgeLength=0.0001, MinTolerance=0, Refine=True, RefineAngle=0, RelativeTolerance=0.65, SimplePlanes=True, Tolerance=0})
mshadow = MeshShadow(Mesh=mesh, Light=Vector(0, 0, -1), Plane=PlaneXY(0, 0, 0))
demesh = DeconstructMesh(Mesh=mesh)  # -> Vertices, Faces, Colours, Normals
pdecon = Deconstruct(Point=demesh.Vertices)  # -> XComponent, YComponent, ZComponent
panel = Panel("Deconstructs simple extrusions into polylines, heights, and base heights for later use in ‘Polygon to GeoJSON component’.")
panel_2 = Panel(""" 
INPUTS: 

Brep (B) - Extruded or capped Breps. Must be extruded in the z axis. """)
panel_3 = Panel("""OUTPUTS:

Polyline (Crv)- Projected base polyline of Brep.

Height (H) - Height of Brep.The distance of extrusion. 

Base Height (BH) - The height of the base of the brep from the ground XY Plane.""")
sort = SortList(Keys=pdecon.ZComponent)  # -> Keys, ValuesA
item = ListItem(List=sort.Keys, Index=0, Wrap=True)  # -> Item1, Item
panel_4 = Panel("For more documentation visit: github.com/madeleinejohanson/Humpback")
subtraction = Subtraction(A=item.Item1, B=item.Item)
bh = Data(simplify(flatten(subtraction)))
bh_2 = Data(simplify(flatten(item.Item)))
Z = UnitZ(Factor=bh_2)
merge = Merge(Data1="DECONSTRUCT EXTRUSION", Data2=panel, Data3=panel_2, Data4=panel_3, Data5=panel_4)
move = Move(Geometry=flatten(mshadow), Motion=Z)  # -> Geometry, Transform
doc = Text(merge)
doc_2 = ClusterOutput(doc)
panel_5 = Panel(doc)

# ---- group: Cluster Output
bh_3 = ClusterOutput(bh)

# ----
bh_4 = ClusterOutput(bh_2)
G = ClusterOutput(move.Geometry)

# ==== cluster OrientNE: Orients geometry
panel = Panel("Orients geometry to specified Northing and Easting Coordinates")
panel_2 = Panel("""OUTPUTS:

Geometry (G) - Reoriented geometry

Point (Pt) - Coordinates represented as a point""")
panel_3 = Panel(""" 
INPUTS: 

Geometry (G) - Geometry to move.

Initial Plane (P) - Plane to move geometry from.

Northing (N) - Specified Northing coordinates as floating point 
eg. -33.857702

Easting(E) - Specified Easting coordinates as floating point 
eg. 151.203655""")
E = ClusterInput()
N = ClusterInput()
P = ClusterInput()
G = ClusterInput()
number_slider = Slider(100000, range=0..100000)
xy = XYPlane(Origin=Point(0, 0, 0))
E_2 = Number(E)
N_2 = Number(N)
G_2 = Geometry(G)
P_2 = Source(P)
panel_4 = Panel("For more documentation visit: github.com/madeleinejohanson/Humpback")
merge = Merge(Data1=P, Data2=xy)
multiplication = Multiplication(A=N_2, B=number_slider)
multiplication_2 = Multiplication(A=E_2, B=number_slider)
item = ListItem(List=merge, Index=0, Wrap=True)
pt = ConstructPoint(XCoordinate=multiplication_2, YCoordinate=multiplication, ZCoordinate=0)
orient = Orient(Geometry=G_2, Source=item, Target=pt)  # -> Geometry, Transform
G_3 = ClusterOutput(orient.Geometry)
pt_2 = ClusterOutput(pt)
merge_2 = Merge(Data1="ORIENT(N,E)", Data2=panel, Data3=panel_3, Data6=panel_2, Data7=panel_4)
doc = Text(merge_2)
doc_2 = ClusterOutput(doc)
panel_5 = Panel(doc)

# ==== cluster UberTrim: Better version of Trim
data = ClusterInput()
bool = ClusterInput()
data_2 = Data(data)
trim = TrimTree(Tree=data_2, Depth=1)
null = NullItem(Item=trim)  # -> NullFlags, InvalidFlags, Description
dispatch = Dispatch(List=data_2, DispatchPattern=null.NullFlags)  # -> ListA, ListB
bool_2 = Boolean(bool)
trim_2 = TrimTree(Tree=dispatch.ListB, Depth=1)
bool_3 = Boolean(invert(null.NullFlags))
flatten = FlattenTree(Tree=dispatch.ListA, Path="{0}")
merge = Merge(Data1=flatten, Data2=trim_2)
panel = Panel(null.NullFlags)
trim_3 = TrimTree(Tree=data_2, Depth=bool_3)
bool_4 = Boolean(invert(bool_2))
data_3 = Data(trim_3)
dispatch_2 = Dispatch(List=merge, DispatchPattern=bool_4)  # -> ListA, ListB
dispatch_3 = Dispatch(List=data_3, DispatchPattern=bool_2)  # -> ListA, ListB
clean = CleanTree(RemoveNulls=True, RemoveInvalid=True, RemoveEmpty=True, Tree=dispatch_3.ListB)
clean_2 = CleanTree(RemoveNulls=True, RemoveInvalid=True, RemoveEmpty=True, Tree=dispatch_2.ListB)
merge_2 = Merge(Data1=clean, Data2=clean_2)
R = ClusterOutput(merge_2)
panel_2 = Panel(merge_2)

# ==== cluster Wrapper: Wraps data with a wrapping character
join = ClusterInput()  # Join character
content = ClusterInput()  # Content to be wrapped
wrap = ClusterInput()  # Wrap character or XML tag
txt = Text(join)
null = NullItem(Item=txt)  # -> NullFlags, InvalidFlags, Description
data = Data(content)
tmatch = MatchText(Text=wrap, RegEx="<*.>", Case=True)
bool = Boolean(null.NullFlags)
dispatch = Dispatch(List=data, DispatchPattern=bool)  # -> ListA, ListB
item = ListItem(List=wrap, Index=0, Wrap=True)
split = TextSplit(Text=item, Separators=" ")
join_2 = TextJoin(Text=dispatch.ListB, Join=txt)
panel = Panel("""{
[
(
"
'""")
panel_2 = Panel("""{█}
[█]
(█)
"█"
'█'""")
item_2 = ListItem(List=split, Index=0, Wrap=True)
weave = Weave(Pattern=bool, Stream0=join_2, Stream1=dispatch.ListA, NullGaps=False)
data_2 = Data(wrap)
replace = ReplaceMembers(Set=data_2, Find=panel, Replace=panel_2)
rep = ReplaceText(Text=item_2, Find="<", Replace="</", RecursiveReplace=False)
expression = Expression(x=item, y=rep, Expression="Format(\"{0}█{1}>\", x, y)")
rep_2 = ReplaceText(Text=expression, Find=">>", Replace=">", RecursiveReplace=False)
weave_2 = Weave(Pattern=tmatch, Stream0=replace, Stream1=rep_2, NullGaps=False)
rep_3 = ReplaceText(Text=weave_2, Find="█", Replace=weave, RecursiveReplace=False)
data_3 = Data(rep_3)
wrapped = ClusterOutput(data_3)  # Wrapped Output
