# Grasshopper definition creating_GeoJSON [Nov-02 '17, 2212].gh (Grasshopper 0.9.76)

layer_tres = Data("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")
layer_uno = Data("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")
layer2 = Data("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")
panel = Panel("watertowers.GeoJSON")  # disabled
merge = Merge()
toggle = BooleanToggle(False)  # disabled
panel_2 = Panel("D:\Projects")  # disabled
mergegj = MergeGeoJSON()  # -> doc_2, R
file_write = FileWrite(file_path=panel_2, T=panel, activate=toggle)  # disabled

# ==== cluster FileWrite: Exports text to file
content = ClusterInput()
file_path = ClusterInput()
activate = ClusterInput()
T = ClusterInput()
content_2 = Data(content)
file_path_2 = Text(file_path)
join = TextJoin(Text=[file_path_2, T], Join="\")
vb = VBScript(path=simplify(join), lines=simplify(content_2), activate=activate)  # -> out, A
# ---------- vb: VB ----------
    If (activate = True)
      
      system.IO.File.WriteAllText(path, lines)
      A = "File written"
    Else
      A = "Not activated"
    End If
# ---------- end vb ----------

# ==== cluster MergeGeoJSON: Merges multiple GeoJSON FeatureCollection files as one FeatureCollection.
panel = Panel("Merges multiple GeoJSON FeatureCollection files as one FeatureCollection. ")
data = ClusterInput()
panel_2 = Panel(""" 
INPUTS: 

GeoJSON Datasets (D) - Accept multiple FeatureCollections. Created for merging the outputs of "Polygon to GeoJSON" components. """)
panel_3 = Panel("""OUTPUTS:

GeoJSON(J) - Merged GeoJSON file as one Feature Colleciton """)
data_2 = Data(data)
panel_4 = Panel("For more documentation visit: github.com/madeleinejohanson/Humpback")
join = TextJoin(Text=data_2)
rep = ReplaceText(Text=join, Find="]}{\"type\":\"FeatureCollection\",\"features\":[", Replace=",", RecursiveReplace=False)
R = ClusterOutput(rep)
merge = Merge(Data1="GEOJSON MERGE", Data2=panel, Data3=panel_2, Data4=panel_3, Data5=panel_4)
doc = Text(merge)
panel_5 = Panel(doc)
doc_2 = ClusterOutput(doc)
