# Grasshopper definition creating_GeoJSON.gh (Grasshopper 0.9.76)
# Copyright: Co-de-iT

panel = Panel("""{"type":"FeatureCollection", "features": [
{"type":"Feature","geometry":{"type":"Polygon","coordinates":[[[151.0653474070001,-33.79681656399998],[151.06576931100005,-33.79730786899995],[151.06598243500002,-33.79787559699997],[151.0660558720001,-33.80248772099998],[151.06618154200012,-33.80298155999998],[151.06663585700005,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
{"type":"Feature","geometry":{"type":"Polygon","coordinates":[[[151.02800411100012,-33.80899607599997],[151.02880977600012,-33.80907947399993],[151.029795239,-33.80935545699998],[151.03031726300003,-33.80855435199993],[151.03173674700008,-33.80509350099993],[151.03206619600007,-33.804755487999955],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
{"type":"Feature","geometry":{"type":"Polygon","coordinates":[[[151.06520159000002,-33.79651244299998],[151.06372596800009,-33.796753516999956],[151.05921230500007,-33.79775653099995],[151.05699777700013,-33.79872557999994],[151.05728970400003,-33.79919275999998],[151.0569846010001,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
{"type":"Feature","geometry":{"type":"Polygon","coordinates":[[[151.06551337300004,-33.79073282099995],[151.06591304800008,-33.79031375899996],[151.0651967350001,-33.79022303499994],[151.06530240300003,-33.789749212999936],[151.06570883000006,-33.78974364499993],[151.06614573500008,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
{"type":"Feature","geometry":{"type":"Polygon","coordinates":[[[151.06399402400007,-33.856157996999976],[151.0614359210001,-33.854839668999944],[151.0630740050001,-33.85259909699994],[151.06386134700006,-33.85213328499998],[151.06306367500008,-33.85119041399997],[151.06020192900007,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
{"type":"Feature","geometry":{"type":"Polygon","coordinates":[[[151.05004200800013,-33.82418400299997],[151.0511029170001,-33.82423820799994],[151.05119186800005,-33.82469463999996],[151.0509750210001,-33.82619067899998],[151.05063309000002,-33.82720681099994],[151.05283243400004,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
{"type":"Feature","geometry":{"type":"Polygon","coordinates":[[[151.07601278000004,-33.86190087799998],[151.07745719500008,-33.86251172999994],[151.07666113000005,-33.86365018299995],[151.0772184120001,-33.86394623799998],[151.07679253000003,-33.86470481199996],[151.07434849000003,-33.86504654399994],[151.07208800900003,-33.86515413999996],[151.07025530700002,-33.86493054899995],[151.0677550570001,-33.86438585299993],[151.0663413750001,-33.86415077399994],[151.0667707980001,-33.86366757299993],[151.06731355300008,-33.862586154999974],[151.06971171300006,-33.85854011299995],[151.07611246200008,-33.86126854799994],[151.07601278000004,-33.86190087799998]]]},"properties":{"POA_CODE":"POA2129", "Distance":4, "Ratio":5}},
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""")

layer1 = Data("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")
layer2 = Data("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")
layer3 = Data("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")

merge = Merge(Data1=layer1, Data2=layer2, Data3=layer3, Data4=panel)

layer_tres = Data("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")
layer_uno = Data("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")
layer_dos = Data("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")

mergegj = MergeGeoJSON(data=merge)  # -> doc_2, R
file_write = FileWrite(content=mergegj.R, file_path="D:\Projects", T="watertowersficc.GeoJSON", activate=Toggle(True))
tower_base = Point(Point(15119405.22, -3385039.022, 2.328306437e-10))
random_seed = Slider(3.81, range=0..10)
towerpolygen = TowerPolyGen(tower_base=tower_base, random_seed=random_seed, colour="white", layer="hubs")  # -> tower, J
file_write_2 = FileWrite(content=towerpolygen.J, file_path="D:\Projects", T="workinmebe.GeoJSON", activate=Toggle(True))

# ==== cluster FileWrite: Exports text to file
content = ClusterInput()
file_path = ClusterInput()
activate = ClusterInput()
T = ClusterInput()
content_2 = Data(content)
file_path_2 = Text(file_path)
join = TextJoin(Text=[file_path_2, T], Join="\")
vb = VBScript(path=simplify(join), lines=simplify(content_2), activate=activate)  # -> out, A
# ---------- vb: VB ----------
    If (activate = True)
      
      system.IO.File.WriteAllText(path, lines)
      A = "File written"
    Else
      A = "Not activated"
    End If
# ---------- end vb ----------

# ==== cluster MergeGeoJSON: Merges multiple GeoJSON FeatureCollection files as one FeatureCollection.
panel = Panel("Merges multiple GeoJSON FeatureCollection files as one FeatureCollection. ")
data = ClusterInput()
panel_2 = Panel(""" 
INPUTS: 

GeoJSON Datasets (D) - Accept multiple FeatureCollections. Created for merging the outputs of "Polygon to GeoJSON" components. """)
panel_3 = Panel("""OUTPUTS:

GeoJSON(J) - Merged GeoJSON file as one Feature Colleciton """)
data_2 = Data(data)
panel_4 = Panel("For more documentation visit: github.com/madeleinejohanson/Humpback")
join = TextJoin(Text=data_2)
rep = ReplaceText(Text=join, Find="]}{\"type\":\"FeatureCollection\",\"features\":[", Replace=",", RecursiveReplace=False)
R = ClusterOutput(rep)
merge = Merge(Data1="GEOJSON MERGE", Data2=panel, Data3=panel_2, Data4=panel_3, Data5=panel_4)
doc = Text(merge)
panel_5 = Panel(doc)
doc_2 = ClusterOutput(doc)

# ==== cluster TowerPolyGen
random_seed = ClusterInput()
tower_base = ClusterInput()
towerpoly = TowerPoly(tower_base=tower_base, random_seed=random_seed)  # -> tower_2, curve_2, height_2, base_height_2
layer = ClusterInput()
colour = ClusterInput()
colour_2 = Data(colour)
layer_2 = Data(layer)
base_height = Data(towerpoly.base_height_2)
curve = Data(towerpoly.curve_2)
height = Data(towerpoly.height_2)
panel = Panel(height)
panel_2 = Panel(base_height)
panel_3 = Panel(colour_2)
panel_4 = Panel(layer_2)
panel_5 = Panel("""height
base_height
colour
layer""")
entwine = Entwine(Branch00=panel, Branch01=panel_2, Branch02=panel_3, Branch03=panel_4, FlattenInputs=True)
tower = ClusterOutput(towerpoly.tower_2)
polyjson_1_1 = PolygonToGeoJSON11(P=curve, K=panel_5, V=entwine)  # -> doc_2, J_2
J = ClusterOutput(polyjson_1_1.J_2)

# ==== cluster PolygonToGeoJSON11: Writes a polygon to a GeoJSON file, where keys and values can be defined.
P = ClusterInput()
P_2 = Curve(P)
cp = ControlPoints(Curve=P_2)  # -> simplify(Points), Weights, Knots
V = ClusterInput()
K = ClusterInput()
V_2 = Data(simplify(V))
points_to_coordinates = PointsToCoordinates(P=cp.Points)
K_2 = Text(simplify(K))
clean = CleanTree(RemoveNulls=True, RemoveInvalid=True, RemoveEmpty=True, Tree=V_2)
viewer = ParamViewer(clean)
flip = FlipMatrix(Data=clean)
graft = GraftTree(Tree=K_2, IncludeEmptyLists=True, IncludeNullItems=True)  # -> simplify(Tree)
viewer_2 = ParamViewer(graft)
short = ShortestList(ListA=viewer_2, ListB=viewer, TrimMode=2)  # -> ListA, ListB
lng = ListLength(List=flatten(short.ListB))
series = Series(Start=0, Step=1, Count=lng)
item = ListItem(List=viewer_2, Index=series, Wrap=False)
flip_2 = FlipMatrix(Data=flip)
branch = TreeBranch(Tree=graft, Path=item, MaintainPaths=True)
clean_2 = CleanTree(RemoveNulls=True, RemoveInvalid=True, RemoveEmpty=True, Tree=branch)
flatten = FlattenTree(Tree=clean_2, Path="{0}")
rep = ReplaceText(Text="\"█\"", Find="█", Replace=flatten, RecursiveReplace=False)  # -> flatten(Result)
series_2 = Series(Start=0, Step=1, Count=lng)
mindex = MemberIndex(Set=rep, Member="\"height\"")  # -> Index, Count
rep_2 = ReplaceText(Text="{ \"type\": \"Polygon\",█}", Find="█", Replace=points_to_coordinates, RecursiveReplace=False)

# ---- group: Polygon
flatten_2 = FlattenTree(Tree=rep_2, Path="{0}")

# ----
mindex_2 = MemberIndex(Set=rep, Member="\"base_height\"")  # -> Index, Count
panel = Panel("Writes a polygon to a GeoJSON file, where keys and values can be defined. ")
panel_2 = Panel("""OUTPUTS:

GeoJSON (J) - Produces a GeoJSON Feature Collection.""")
panel_3 = Panel(""" 
INPUTS: 

Polyline Curve (P) - Polygon or list of polygons to convert to GeoJSON.

Key (K)- Properties used to describe geometry. To specify height, base height and colour, use the following keys: 

height
base_height
colour 

Value (V) - Values of properties. The list should be structured so that the first branch of data is associated with the first key. This allows unique values to be associated with multiple polygons. """)
panel_4 = Panel("For more documentation visit: github.com/madeleinejohanson/Humpback")
rep_3 = ReplaceText(Text="{\"type\":\"Feature\",\"geometry\":█", Find="█", Replace=flatten_2, RecursiveReplace=False)
merge = Merge(Data1="POLYGON TO GEOJSON", Data2=panel, Data3=panel_3, Data6=panel_2, Data7=panel_4)
doc = Text(merge)
doc_2 = ClusterOutput(doc)
panel_5 = Panel(doc)

# ---- group: Keeps lists consistent lengths, repeating the last value for the total amount of keys
null = NullItem(Item=flip)  # -> NullFlags, InvalidFlags, Description
dispatch = Dispatch(List=flip, DispatchPattern=null.NullFlags)  # -> ListA, ListB
nullrep = ReplaceNulls(Items=flip, Replacements="█")  # -> Items, Count
index = ItemIndex(List=dispatch.ListB, Item=dispatch.ListB)
item_2 = ListItem(List=flip, Index=index, Wrap=True)
mindex_3 = MemberIndex(Set=nullrep.Items, Member="█")  # -> Index, Count
flip_3 = FlipMatrix(Data=item_2)
clean_3 = CleanTree(RemoveNulls=True, RemoveInvalid=True, RemoveEmpty=False, Tree=flip_3)
item_3 = ListItem(List=clean_3, Index=0, Wrap=True)  # -> flatten(Item1), Item

# ----
merge_2 = Merge(Data1=flip_3, Data2=flip_2)
clean_4 = CleanTree(RemoveNulls=True, RemoveInvalid=True, RemoveEmpty=False, Tree=merge_2)
item_4 = ListItem(List=clean_4, Index=0, Wrap=True)  # -> flatten(Item1), Item

# ---- group: Keeps lists consistent lengths, repeating the last value for the total amount of keys (continued)
item_5 = ListItem(List=item_4.Item1, Index=mindex_3.Index, Wrap=True)
replace = ReplaceItems(List=nullrep.Items, Item=item_5, Indices=mindex_3.Index, Wrap=False)

# ----
flip_4 = FlipMatrix(Data=replace)
viewer_3 = ParamViewer(flip_4)
item_6 = ListItem(List=viewer_3, Index=series_2, Wrap=True)

# ---- group: Keeps lists consistent lengths, repeating the last value for the total amount of keys (continued)
branch_2 = TreeBranch(Tree=flip_4, Path=item_6, MaintainPaths=True)  # -> simplify(Branch)

# ----
flip_5 = FlipMatrix(Data=branch_2)

# ---- group: height
item_7 = ListItem(List=flip_5, Index=mindex.Index, Wrap=True)

# ---- group: base_height
item_8 = ListItem(List=flip_5, Index=mindex_2.Index, Wrap=True)

# ----
addition = Addition(A=item_7, B=item_8)
replace_2 = ReplaceItems(List=simplify(flip_5), Item=addition, Indices=mindex.Index, Wrap=False)  # -> simplify(List)
clean_5 = CleanTree(RemoveNulls=True, RemoveInvalid=True, RemoveEmpty=True, Tree=replace_2)
key_value = KeyValue(K=clean_2, V=clean_5)
rep_4 = ReplaceText(Text=",\"properties\":█}", Find="█", Replace=key_value, RecursiveReplace=False)

# ---- group: Feature
concat = Concatenate(FragmentA=rep_3, FragmentB=rep_4)  # -> flatten(Result)

# ----
join = TextJoin(Text=concat, Join=",")
panel_6 = Panel(key_value)
rep_5 = ReplaceText(Text="{\"type\":\"FeatureCollection\",\"features\":[█]}", Find="█", Replace=join, RecursiveReplace=False)
J = Text(rep_5)
J_2 = ClusterOutput(J)

# ==== cluster TowerPoly
tower_base = ClusterInput()
level_thickness = Slider(2, range=0..5)
tower_height = Slider(180, range=0..300)
leaf_amount = Slider(6, range=1..7)
stem_radius = Slider(5.6, range=1..20)
randomise_angle = BooleanToggle(True)
random_seed = ClusterInput()
leaf_angle = Slider(2.867, range=0..6.283)
tower_base_2 = Point(tower_base)
random_seed_2 = Data(random_seed)
bottom_right = Point(Point(5143.874652, -4040.62199, 0))
top_left = Point(Point(-7096.812867, 2577.217604, 0))
panel = Panel("bottom right")
panel_2 = Panel("top left")
simple_water_tower = SimpleWaterTower(
    tower_base=tower_base_2,
    level_thickness=level_thickness,
    tower_height=tower_height,
    leaf_angle=leaf_angle,
    stem_radius=stem_radius,
    randomised_angles=randomise_angle,
    leaf_amount=leaf_amount,
    random_seed=random_seed_2)
number_slider = Slider(0, range=0..6)
pdecon = Deconstruct(Point=top_left)  # -> XComponent, YComponent, ZComponent
pdecon_2 = Deconstruct(Point=bottom_right)  # -> XComponent, YComponent, ZComponent
pdecon_3 = Deconstruct(Point=tower_base_2)  # -> XComponent, YComponent, ZComponent
tower = Brep(simple_water_tower)
dom = ConstructDomain(DomainStart=Slider(-33.818231, range=-33.883882..-33.818231), DomainEnd=Slider(-33.883882, range=-33.883882..-33.818231))
dom_2 = ConstructDomain(DomainStart=Slider(151.109357, range=151.109357..151.25466), DomainEnd=Slider(151.25466, range=151.109357..151.25466))
dom_3 = ConstructDomain(DomainStart=pdecon.XComponent, DomainEnd=pdecon_2.XComponent)
dom_4 = ConstructDomain(DomainStart=pdecon.YComponent, DomainEnd=pdecon_2.YComponent)
item = ListItem(List=flatten(tower), Index=number_slider, Wrap=True)
remap = RemapNumbers(Value=pdecon_3.YComponent, Source=dom_4, Target=dom_2)  # -> Mapped, Clipped
debrep = DeconstructBrep(Brep=item)  # -> Faces, Edges, Vertices
remap_2 = RemapNumbers(Value=pdecon_3.XComponent, Source=dom_3, Target=dom)  # -> Mapped, Clipped
deextrusion_1_1 = DeconstructExtrusion11(brep=tower)  # -> doc_2, G, bh_3, bh_4
item_2 = ListItem(List=flatten(debrep.Faces), Index=number_slider, Wrap=True)
tower_2 = ClusterOutput(tower)
split = SplitList(List=deextrusion_1_1.G, Index=Slider(1, range=0..1))  # -> ListA, ListB
debrep_2 = DeconstructBrep(Brep=item_2)  # -> Faces, Edges, Vertices
len = Length(Curve=debrep_2.Edges)  # -> expr("x/15", Length)
topoly = CurveToPolyline(Curve=debrep_2.Edges, ToleranceDistance=0, ToleranceAngle=0, MinEdge=len)  # -> Polyline, Segments
merge = Merge(Data1=topoly.Polyline, Data2=split.ListB)
base_height = Data(deextrusion_1_1.bh_4)
height = Data(deextrusion_1_1.bh_3)
curve = Data(merge)
orientne = OrientNE(G=merge, P=tower_base_2, N=remap_2.Mapped, E=remap.Mapped)  # -> doc_2, G_3, pt_2
height_2 = ClusterOutput(height)
curve_2 = ClusterOutput(curve)
base_height_2 = ClusterOutput(base_height)

# ==== cluster PointsToCoordinates
P = ClusterInput()
number_slider = Slider(100042, range=0..1000000)
pt2num = PointsToNumbers(Points=graft(P), Mask=4)
number_slider_2 = Slider(1000404, range=0..10000000)
division = Division(A=pt2num, B=Slider(100000, range=0..100000))
expression = Expression(x=division, Expression="format(\"{0}\",x)")
int = Integer(99960)
item = ListItem(List=expression, Index=0, Wrap=True)  # -> Item, Item1, Item2
panel = Panel(pt2num)
num = Number(item.Item2)  # disabled
merge = Merge(Data1=item.Item, Data2=item.Item1, Data3=num)
panel_2 = Panel(division)
wrapper = Wrapper(wrap="[", content=merge, join=",")  # -> simplify(wrapped)
utrim = UberTrim(data=wrapper, bool=Toggle(True))
wrapper_2 = Wrapper(wrap="[", content=utrim, join=",")
rep = ReplaceText(Text="\"coordinates\": [█]", Find="█", Replace=wrapper_2, RecursiveReplace=False)  # -> simplify(Result)
R = ClusterOutput(rep)

# ==== cluster KeyValue
K = ClusterInput()
V = ClusterInput()
K_2 = Text(simplify(K))
V_2 = Data(simplify(V))

# ---- group: HUMPBACK 1.1 Treats numbers as numbers instead of strings
int = Integer(V_2)
null = NullItem(Item=int)  # -> NullFlags, InvalidFlags, Description
panel = Panel("""█
"█"
""")
item = ListItem(List=panel, Index=null.NullFlags, Wrap=True)
rep = ReplaceText(Text=item, Find="█", Replace=V_2, RecursiveReplace=False)

# ----
panel_2 = Panel(K_2)
rep_2 = ReplaceText(Text="\"█\"", Find="█", Replace=K_2, RecursiveReplace=False)  # -> simplify(Result)
panel_3 = Panel("\"█\"")  # disabled
panel_4 = Panel("█")  # disabled
rep_3 = ReplaceText(Text=panel_3, Find=panel_4, Replace=V_2, RecursiveReplace=False)  # disabled
flip = FlipMatrix(Data=rep)  # -> simplify(Data)
lng = ListLength(List=flatten(rep_2))
viewer = ParamViewer(flip)
series = Series(Start=0, Step=1, Count=lng)
item_2 = ListItem(List=viewer, Index=series, Wrap=True)
branch = TreeBranch(Tree=simplify(flip), Path=simplify(item_2), MaintainPaths=True)
long = LongestList(ListA=rep_2, ListB=branch, PaddingMode=2)  # -> ListA, ListB
merge = Merge(Data1=graft(long.ListA), Data2=graft(long.ListB))
join = TextJoin(Text=merge, Join=":")
trim = TrimTree(Tree=join, Depth=1)
flip_2 = FlipMatrix(Data=trim)
join_2 = TextJoin(Text=flip_2, Join=",")
rep_4 = ReplaceText(Text="{█}", Find="█", Replace=join_2, RecursiveReplace=False)  # -> flatten(Result)
J = Text(rep_4)
J_2 = ClusterOutput(J)

# ==== cluster SimpleWaterTower
level_thickness = ClusterInput()
tower_base = ClusterInput()
randomised_angles = ClusterInput()
stem_radius = ClusterInput()
tower_height = ClusterInput()
random_seed = ClusterInput()
leaf_angle = ClusterInput()
leaf_amount = ClusterInput()
level_thickness_2 = Data(level_thickness)
tower_base_2 = Point(tower_base)
randomised_angles_2 = Boolean(randomised_angles)
stem_radius_2 = Data(stem_radius)
tower_height_2 = Data(tower_height)
leaf_angle_2 = Data(leaf_angle)
random_seed_2 = Data(random_seed)
leaf_amount_2 = Data(leaf_amount)
Z = UnitZ(Factor=tower_height_2)
range = Range(Domain=Domain(0.1, 1), Steps=expr("x+1", leaf_amount_2))
move = Move(Geometry=tower_base_2, Motion=Z)  # -> Geometry, Transform
leaf_base_point = Point(Point(3.896008657, -18.35570401, 0))
random = Random(Range=Domain(0, 6.283), Number=leaf_amount_2, Seed=random_seed_2)
crv = Curve(<curve referenced from the Rhino model>)
ln = Line(StartPoint=tower_base_2, EndPoint=move.Geometry)
multiplication = Multiplication(A=random, B=randomised_angles_2)
cyl = Cylinder(Base=tower_base_2, Radius=stem_radius_2, Length=tower_height_2)
split = SplitList(List=range, Index=Slider(1, range=0..1))  # -> ListA, ListB
addition = Addition(A=leaf_angle_2, B=multiplication)
split_2 = SplitList(List=split.ListB, Index=leaf_amount_2)  # -> ListA, ListB
rotate = Rotate(Geometry=crv, Angle=addition, Plane=leaf_base_point)  # -> Geometry, Transform
cap = CapHoles(Brep=cyl)
eval = EvaluateCurve(Curve=ln, Parameter=split_2.ListA)  # -> Point, Tangent, Angle
vec2pt = Vector2Pt(PointA=leaf_base_point, PointB=eval.Point, Unitize=False)  # -> Vector, Length
move_2 = Move(Geometry=rotate.Geometry, Motion=vec2pt.Vector)  # -> Geometry, Transform
Z_2 = UnitZ(Factor=level_thickness_2)
boundary = BoundarySurfaces(Edges=move_2.Geometry)
extr = Extrude(Base=boundary, Direction=Z_2)
merge = Merge(Data1=extr, Data2=cap)
tower = Brep(merge)
tower_2 = ClusterOutput(tower)

# ==== cluster DeconstructExtrusion11: Deconstructs simple extrusions into polylines, heights, and base heights for later use in ‘Polygon to GeoJSON component’.
brep = ClusterInput()
brep_2 = Brep(simplify(graft(brep)))
cap = CapHoles(Brep=brep_2)
mesh = MeshBrep(
    Brep=cap,
    Settings={GridMaxCount=0, GridMinCount=16, JaggedSeams=False, MaxEdgeLength=0, MinEdgeLength=0.0001, MinTolerance=0, Refine=True, RefineAngle=0, RelativeTolerance=0.65, SimplePlanes=True, Tolerance=0})
mshadow = MeshShadow(Mesh=mesh, Light=Vector(0, 0, -1), Plane=PlaneXY(0, 0, 0))
demesh = DeconstructMesh(Mesh=mesh)  # -> Vertices, Faces, Colours, Normals
pdecon = Deconstruct(Point=demesh.Vertices)  # -> XComponent, YComponent, ZComponent
panel = Panel("Deconstructs simple extrusions into polylines, heights, and base heights for later use in ‘Polygon to GeoJSON component’.")
panel_2 = Panel(""" 
INPUTS: 

Brep (B) - Extruded or capped Breps. Must be extruded in the z axis. """)
panel_3 = Panel("""OUTPUTS:

Polyline (Crv)- Projected base polyline of Brep.

Height (H) - Height of Brep.The distance of extrusion. 

Base Height (BH) - The height of the base of the brep from the ground XY Plane.""")
sort = SortList(Keys=pdecon.ZComponent)  # -> Keys, ValuesA
item = ListItem(List=sort.Keys, Index=0, Wrap=True)  # -> Item1, Item
panel_4 = Panel("For more documentation visit: github.com/madeleinejohanson/Humpback")
subtraction = Subtraction(A=item.Item1, B=item.Item)
bh = Data(simplify(flatten(subtraction)))
bh_2 = Data(simplify(flatten(item.Item)))
Z = UnitZ(Factor=bh_2)
merge = Merge(Data1="DECONSTRUCT EXTRUSION", Data2=panel, Data3=panel_2, Data4=panel_3, Data5=panel_4)
move = Move(Geometry=flatten(mshadow), Motion=Z)  # -> Geometry, Transform
doc = Text(merge)
doc_2 = ClusterOutput(doc)
panel_5 = Panel(doc)

# ---- group: Cluster Output
bh_3 = ClusterOutput(bh)

# ----
bh_4 = ClusterOutput(bh_2)
G = ClusterOutput(move.Geometry)

# ==== cluster OrientNE: Orients geometry
panel = Panel("Orients geometry to specified Northing and Easting Coordinates")
panel_2 = Panel("""OUTPUTS:

Geometry (G) - Reoriented geometry

Point (Pt) - Coordinates represented as a point""")
panel_3 = Panel(""" 
INPUTS: 

Geometry (G) - Geometry to move.

Initial Plane (P) - Plane to move geometry from.

Northing (N) - Specified Northing coordinates as floating point 
eg. -33.857702

Easting(E) - Specified Easting coordinates as floating point 
eg. 151.203655""")
E = ClusterInput()
N = ClusterInput()
P = ClusterInput()
G = ClusterInput()
number_slider = Slider(100000, range=0..100000)
xy = XYPlane(Origin=Point(0, 0, 0))
E_2 = Number(E)
N_2 = Number(N)
G_2 = Geometry(G)
P_2 = Source(P)
panel_4 = Panel("For more documentation visit: github.com/madeleinejohanson/Humpback")
merge = Merge(Data1=P, Data2=xy)
multiplication = Multiplication(A=N_2, B=number_slider)
multiplication_2 = Multiplication(A=E_2, B=number_slider)
item = ListItem(List=merge, Index=0, Wrap=True)
pt = ConstructPoint(XCoordinate=multiplication_2, YCoordinate=multiplication, ZCoordinate=0)
orient = Orient(Geometry=G_2, Source=item, Target=pt)  # -> Geometry, Transform
G_3 = ClusterOutput(orient.Geometry)
pt_2 = ClusterOutput(pt)
merge_2 = Merge(Data1="ORIENT(N,E)", Data2=panel, Data3=panel_3, Data6=panel_2, Data7=panel_4)
doc = Text(merge_2)
doc_2 = ClusterOutput(doc)
panel_5 = Panel(doc)

# ==== cluster UberTrim: Better version of Trim
data = ClusterInput()
bool = ClusterInput()
data_2 = Data(data)
trim = TrimTree(Tree=data_2, Depth=1)
null = NullItem(Item=trim)  # -> NullFlags, InvalidFlags, Description
dispatch = Dispatch(List=data_2, DispatchPattern=null.NullFlags)  # -> ListA, ListB
bool_2 = Boolean(bool)
trim_2 = TrimTree(Tree=dispatch.ListB, Depth=1)
bool_3 = Boolean(invert(null.NullFlags))
flatten = FlattenTree(Tree=dispatch.ListA, Path="{0}")
merge = Merge(Data1=flatten, Data2=trim_2)
panel = Panel(null.NullFlags)
trim_3 = TrimTree(Tree=data_2, Depth=bool_3)
bool_4 = Boolean(invert(bool_2))
data_3 = Data(trim_3)
dispatch_2 = Dispatch(List=merge, DispatchPattern=bool_4)  # -> ListA, ListB
dispatch_3 = Dispatch(List=data_3, DispatchPattern=bool_2)  # -> ListA, ListB
clean = CleanTree(RemoveNulls=True, RemoveInvalid=True, RemoveEmpty=True, Tree=dispatch_3.ListB)
clean_2 = CleanTree(RemoveNulls=True, RemoveInvalid=True, RemoveEmpty=True, Tree=dispatch_2.ListB)
merge_2 = Merge(Data1=clean, Data2=clean_2)
R = ClusterOutput(merge_2)
panel_2 = Panel(merge_2)

# ==== cluster Wrapper: Wraps data with a wrapping character
join = ClusterInput()  # Join character
content = ClusterInput()  # Content to be wrapped
wrap = ClusterInput()  # Wrap character or XML tag
txt = Text(join)
null = NullItem(Item=txt)  # -> NullFlags, InvalidFlags, Description
data = Data(content)
tmatch = MatchText(Text=wrap, RegEx="<*.>", Case=True)
bool = Boolean(null.NullFlags)
dispatch = Dispatch(List=data, DispatchPattern=bool)  # -> ListA, ListB
item = ListItem(List=wrap, Index=0, Wrap=True)
split = TextSplit(Text=item, Separators=" ")
join_2 = TextJoin(Text=dispatch.ListB, Join=txt)
panel = Panel("""{
[
(
"
'""")
panel_2 = Panel("""{█}
[█]
(█)
"█"
'█'""")
item_2 = ListItem(List=split, Index=0, Wrap=True)
weave = Weave(Pattern=bool, Stream0=join_2, Stream1=dispatch.ListA, NullGaps=False)
data_2 = Data(wrap)
replace = ReplaceMembers(Set=data_2, Find=panel, Replace=panel_2)
rep = ReplaceText(Text=item_2, Find="<", Replace="</", RecursiveReplace=False)
expression = Expression(x=item, y=rep, Expression="Format(\"{0}█{1}>\", x, y)")
rep_2 = ReplaceText(Text=expression, Find=">>", Replace=">", RecursiveReplace=False)
weave_2 = Weave(Pattern=tmatch, Stream0=replace, Stream1=rep_2, NullGaps=False)
rep_3 = ReplaceText(Text=weave_2, Find="█", Replace=weave, RecursiveReplace=False)
data_3 = Data(rep_3)
wrapped = ClusterOutput(data_3)  # Wrapped Output
